# Grasshopper definition Skeleton Constructor_Kinect-0212-final.gh (Grasshopper 1.0.7)
# plug-ins: Firefly.Kinect.V2, WSFinder, Excel

# ---- group: kinect demo populate spheres
# Directions: - To start set "trackingOn" to True
# - Toggle "refresh" to reset scene
# - Use the "Data Recorder" component to capture and save sensor data.
number_slider = Slider(10, range=0..10)
# A6-2 grasshopper method
# by Graham & Chia
# 03/12/2024
trackingon = BooleanToggle(False)
refresh = Button()
skeleton = KinectV2SkeletonTracker(StartSkeletonTracker=trackingon)  # -> Joints, JointIDs, Bones
skeleton_constructor = PythonScript(
    input=skeleton.Joints,
    jointID=skeleton.JointIDs,
    refresh=refresh,
    distanceThreshold=number_slider,
    trail=Slider(30, range=0..200),
    counter=Slider(1000, range=0..1000))  # -> out, trail, fullSkeleton; inputs input: list of Point3d, jointID: list, refresh: Boolean, trail: Int32, counter: Int32
# ---------- skeleton_constructor: Python ----------
import rhinoscriptsyntax as rs
import Rhino.Geometry as rg
import scriptcontext as sc

#############################################################################
######### Simple skeleton constructor and gesture event recognition #########
#############################################################################

skeletonID = ["SpineBase",'SpineMid','Neck','Head','ShoulderLeft','ElbowLeft','WristLeft','HandLeft','ShoulderRight','ElbowRight','WristRight','HandRight','HipLeft','KneeLeft','AnkleLeft','FootLeft','HipRight','KneeRight','AnkleRight','FootRight','SpineShoulder','HandTipLeft','ThumbLeft','HandTipRight','ThumbRight']
# clear pose values and construct an empty skeleton dictionary in sc.sticky
def initSkeleton(nameList):
    sc.sticky.clear
    # take a list of joint IDs and make a dictionary with empty values
    skeleton = {key:[] for key in nameList}
    sc.sticky['skeleton'] = skeleton

# append kinect pose to dictionary at appropriate joint  
def addSkeletonPose (currentPose, nameList):
    # pair dict keys and joint values in dictionary
    for key, value in zip(nameList,currentPose):#sc.sticky['rawJoints']):
        sc.sticky['skeleton'][key].append(value)
    return sc.sticky['skeleton']

# retrieve a joint pose(s) by name
def getJoint_s(jointName):
    a = addSkeletonPose(input,jointID)
    joint = a[jointName]
    return joint

# test for a gesture event by joint names    
def gesture(joint1,joint2,threshold):
    if rs.Distance(getJoint_s(joint1)[-1],getJoint_s(joint2)[-1])< threshold:
        return True
#############################################################################
######### Active Scene Constructor ##########################################
#############################################################################

# Example draw a line with the right hand when left hand is touching head 
if refresh:
    initSkeleton(skeletonID)
    sc.sticky["dwgs"] = []
    dwgActive = False
    print "refresh"

else:
    if input==[] or jointID==[]:
        initSkeleton(skeletonID)
        for key in sc.sticky['skeleton']:#sc.sticky['rawJoints']):
            sc.sticky['skeleton'][key].append(0)

    else:
        if gesture('Head','HandLeft',distanceThreshold):
            print "touched head"
            dwgActive = not dwgActive # reset drawing state 
        newLine = []
        new = True
        cnt = 0 
        while dwgActive == True:
            cnt +=1
            print cnt
            if cnt % counter == 0:
                newLine.append(getJoint_s('HandRight'))
            if gesture('Head','HandLeft',distanceThreshold):
    #            print "touched head"
                sc.sticky['dwgs'].append(newLine)
                dwgActive = not dwgActive # reset drawing state

#    leftHandTrail = getJoint_s('HandLeft')[-trail:-1]
    if sc.sticky.get('dwgs')!= []:
        dwg = sc.sticky.get('dwgs')[0]
    trail = getJoint_s('SpineMid')[-trail:-1:10]
#    print dwgActive
#    print sc.sticky['dwgs']
# ---------- end skeleton_constructor ----------
pt = Point(skeleton_constructor.trail)
panel = Panel(skeleton_constructor.out)
pline = PolyLine(Vertices=pt, Closed=False)

# ----
# Both side status detector
# Dynamic movement tracker for "mode", (in here, take moving speed as example)
geo = Geometry(pline)
len = Length(Curve=geo)
panel_2 = Panel(len)
rec = DataRecorder(panel_2, DataLimit=-10, RecordData=False)
panel_3 = Panel(rec)
python = GhPythonScript(list=panel_3)  # -> out, a; inputs list: list
# ---------- python: Python ----------
__author__ = "huiye"
__version__ = "2024.12.02"

import rhinoscriptsyntax as rs
for i in range(0, len(list), 20):
    if list[i] is not None:
       print(list[i])
#print(list)
# ---------- end python ----------
panel_4 = Panel("D:\ahYen's Workspace\ahYen's Work\CMU_academic\MSCD_Y1_2425\48727-Inquiry into Computational Design\A6-2\walkingData.xlsx")
panel_5 = Panel(python.out)
graph = QuickGraph(panel_5, SortOrder=0)
write = ExcelWrite(Start=Toggle(True), FilePath=panel_4, Cell="A1", Data=panel_5)

sample_environment = Geometry([<mesh referenced from the Rhino model> x127, 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, Point(0.04398939759, 2.140790939, 0.04156173021), Point(0.02298652939, 2.123750925, 0.05984060094), Point(0.004422122147, 2.137484312, 0.0644864589)])

# ---- group: Input location and pose to put Message
panel_6 = Panel("studyDesk")
panel_7 = Panel("""sit
stand
lay""")

# ----
number_slider_2 = Slider(0, range=0..10)
allsetpts = Point([Point(1.062952847, 2.578911781, -0.8859670758), Point(0.9413465261, 2.614015341, -0.6030253172), Point(0.8767938018, 2.634766817, -0.3236065805), Point(0.8785201311, 2.624719381, -0.1838961989), Point(0.7240270376, 2.614047527, -0.4132352173), Point(0.7182897925, 2.478439808, -0.6047740579)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])
cluster = Cluster(L=allsetpts, L_2=panel_7, relay=number_slider_2)  # -> i, i_2
panel_8 = Panel(cluster.i_2)

# ----
# Receiver method
real_time_detectedpts = Point(skeleton.Joints)

# ----
# Receiver view direction realtime detect module
panel_9 = Panel("""4
8""")
item = ListItem(List=real_time_detectedpts, Index=panel_9, Wrap=True)
item_2 = ListItem(List=item, Index=0, Wrap=True)  # -> Item, Item1
ln = Line(StartPoint=item_2.Item, EndPoint=item_2.Item1)
pframe = PerpFrame(Curve=reparameterize(ln), Parameter=0.5)
deplane = DeconstructPlane(Plane=pframe)  # -> Origin, XAxis, YAxis, ZAxis
line = LineSDL(Start=deplane.Origin, Direction=expr("-x", deplane.XAxis), Length=Slider(0.517, range=0..1))
end = EndPoints(Curve=line)  # -> Start, End
pt_2 = Point(end.End)

# ---- group: Input pre-save pose pts
sitsetpt = Point(cluster.i)

# ---- group: Receiver motion detect / threshold distance
number_slider_3 = Slider(0.25, range=0..1)

# ---- group: Receiver motion detect / matching rate of the real-time pose btwn pre-save
number_slider_4 = Slider(0.5, range=0..1)

# ---- group: Receiver motion detect
# Receiver motion detect module
dist = Distance(PointA=real_time_detectedpts, PointB=sitsetpt)
spheredisplay = SphereDisplay(Origins=sitsetpt, Radius=number_slider_3)
smaller = SmallerThan(FirstNumber=dist, SecondNumber=number_slider_3)  # -> SmallerThan, OrEqualTo
lng = ListLength(List=dist)
t_f_counter = GhPythonScript(x=smaller.OrEqualTo)  # -> out, t, f; inputs x: list of Boolean
# ---------- t_f_counter: Python ----------
__author__ = "huiye"
__version__ = "2024.11.28"

import rhinoscriptsyntax as rs
i = 0
def count(x):
    t = 0
    f = 0
    for i in range(len(x)):
        if x[i] == True:
            t += 1
        if x[i] == False:
            f += 1
    return t, f

t,f = count(x)
# ---------- end t_f_counter ----------
panel_10 = Panel(t_f_counter.t)
division = Division(A=t_f_counter.t, B=lng)
larger = LargerThan(FirstNumber=division, SecondNumber=number_slider_4)  # -> LargerThan, OrEqualTo
panel_11 = Panel(larger.LargerThan)
switchcase = GhPythonScript(poses=panel_7, index=number_slider_2, switchBool=larger.LargerThan)  # -> out, a; inputs poses: list, index: Int32, switchBool: Boolean
# ---------- switchcase: Python ----------
__author__ = "huiye"
__version__ = "2024.11.28"

import rhinoscriptsyntax as rs

def check(poses,index,switchBool):
    if switchBool == True and index >= 0:
        return poses[index]
    else:
        return None

a = check(poses, index, switchBool)
# ---------- end switchcase ----------
panel_12 = Panel(switchcase.a)
sendsignal = GhPythonScript(location=flatten(panel_6), pose=flatten(panel_12), run=Toggle(True))  # -> out, a, textOutput; inputs location: list, pose: list, run: Boolean
# ---------- sendsignal: Python ----------
__author__ = "huiye"
__version__ = "2024.11.28"
"ref: https://developer.rhino3d.com/guides/rhinopython/python-reading-writing/"

import rhinoscriptsyntax as rs
import Rhino
import System.IO as IO
import os

def write_to_txt(content, filename="output.txt"):
    try:
        # Get the directory of the current Grasshopper file
        gh_doc = ghenv.Component.OnPingDocument()
        gh_file_path = gh_doc.FilePath
        
        # If the file hasn't been saved yet, return None
        if not gh_file_path:
            print("Please save the Grasshopper file first")
            return None
            
        # Get the directory containing the .gh file
        directory = os.path.dirname(gh_file_path)
        
        # Create the full path for the output file
        output_path = os.path.join(directory, filename)
        
        # Write the content to the file
        with open(output_path, 'w') as file:
            file.write(str(content))
            
        return output_path
        
    except Exception as e:
        print(e)
        return None

# Check if we have input
if run and location is not None and pose is not None:
    # If filename is provided, use it; otherwise use default
    output_filename = filename if filename else "output.txt"
    
    # Handle location - if it's a string, keep as is, if it's a list join it
    location_str = location if isinstance(location, str) else ','.join(map(str, location))
    pose_str = pose if isinstance(pose, str) else ','.join(map(str, pose))
    
    # Combine location and pose data
    text2write = location_str + ', ' + pose_str
    
    # Write the content and get the result
    a = write_to_txt(text2write, output_filename)
    textOutput = text2write
else:
    a = None
# ---------- end sendsignal ----------
panel_13 = Panel(sendsignal.a)
panel_14 = Panel(sendsignal.textOutput)

# ----
# Detect if in Pose
python_2 = GhPythonScript(x=pt_2, bool=larger.LargerThan)  # -> out, a; inputs x: Point3d, bool: Boolean
# ---------- python_2: Python ----------
a = x if bool else None
# ---------- end python_2 ----------

animation_path = Curve(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)
curvepoint = PointOnCurve(animation_path, parameter=0)
xy = XYPlane(Origin=curvepoint)
xy_2 = XYPlane(Origin=python_2.a)
orient = Orient(Geometry=animation_path, Source=xy, Target=xy_2)  # -> Geometry, Transform

# ----
# Show Message if user channel is turn on,
# and message exists at the location, and
# user's pose is Matched,
toggle = BooleanToggle(True)
readfile = GhPythonScript(isChannel=toggle, messageExists=panel_14)  # -> out, a; inputs isChannel: Boolean
# ---------- readfile: Python ----------
__author__ = "huiye"
__version__ = "2024.11.28"

import rhinoscriptsyntax as rs
import Rhino
import System.IO as IO
import os

def read_from_txt(filename="message.txt"):
    try:
        # Get the directory of the current Grasshopper file
        gh_doc = ghenv.Component.OnPingDocument()
        gh_file_path = gh_doc.FilePath
        
        if not gh_file_path:
            print("Please save the Grasshopper file first")
            return None
            
        # Get the directory containing the .gh file
        directory = os.path.dirname(gh_file_path)
        
        # Create the full path for the input file
        input_path = os.path.join(directory, filename)
        
        # Read the content from file
        with open(input_path, 'r') as file:
            content = file.read()
            
        return content
        
    except Exception as e:
        print(e)
        return None

# Read the content and assign to output
if isChannel == True and messageExists is True:
    a.append(read_from_txt("message.txt"))
else:
    a = "readMessage:"
# ---------- end readfile ----------
panel_15 = Panel(readfile.a)

# ----
# Sender method
# Sender handwritten message detect module
item_3 = ListItem(List=pline, Index=0, Wrap=True)
geomessage_example = Brep(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)

# ---- group: Toggle to start record
data_recorder = DataRecorder(item_3, DataLimit=-10, RecordData=False)

# ----
crv = Curve(data_recorder)
join = JoinCurves(Curves=crv, Preserve=False)
reb = RebuildCurve(Curve=join, Count=Slider(200, range=0..1000), Tangents=False)
explode = Explode(Curve=reb, Recursive=True)  # -> Segments, Vertices
intcrv = Interpolate(Vertices=explode.Vertices, Degree=3, Periodic=False, KnotStyle=1)  # -> Curve, Length, Domain
pipe = Pipe(Curve=intcrv.Curve, Radius=0.01, Caps=0)
brep = Brep(pipe)

# ---- group: Export method
python_3 = GhPythonScript(x=brep, y="geoMessage", z=Toggle(False))  # -> out, a; inputs x: GeometryBase
# ---------- python_3: Python ----------
import rhinoscriptsyntax as rs
import Rhino.Geometry as rd
import Rhino.FileIO as rf

"""Inputs:
    x: The geometry to export (Access with x)
    y: Filename for the OBJ (just the name, no path needed) (Access with y)
    z: Export toggle (boolean) (Access with z)
"""

def process_geometry(geo):
    mesh = None
    if isinstance(geo, rd.Mesh):
        mesh = geo
    else:
        try:
            mesh = rd.Mesh()
            if isinstance(geo, rd.Brep):
                meshes = rd.Mesh.CreateFromBrep(geo, rd.MeshingParameters.Default)
                for m in meshes:
                    mesh.Append(m)
            else:
                geo.CreateMesh(rd.MeshingParameters.Default)
                mesh = geo.GetMesh()
        except:
            print("Failed to convert to mesh")
            return None
    return mesh

# Get Grasshopper document path
ghdoc = ghenv.Component.OnPingDocument()
gh_file_path = ghdoc.FilePath

if not gh_file_path:
    print("Please save the Grasshopper file first")
else:
    # Get directory of GH file
    gh_directory = gh_file_path.rsplit('\\', 1)[0]
    print(gh_directory)
    
    # Check inputs
    if not z:  # Export toggle
        print("Export not triggered")
    else:
        if not x:  # Geometry
            print("No geometry provided")
        elif not y:  # Filename
            print("No filename provided")
        else:
            try:
                # Create full file path
                filename = y if y.lower().endswith('.3dm') else y + '.3dm'
                full_path = gh_directory + '\\' + filename
                
                # Process geometry to mesh
                mesh = process_geometry(x)
                if mesh:
                    # Create file3dm for export
#                    f3dm = rd.File3dm()
                    f3dm = rf.File3dm()
                    mesh_list = [mesh]
                    
                    # Export to 3DM
                    if rf.File3dm.WriteOneObject(full_path, mesh):
#                        rf.File3dm.WriteOneObject(full_path, mesh_list)
                        print("3DM exported successfully to: " + full_path)
                    else:
                        print("Failed to export 3DM")
            except Exception as e:
                print("Error during export: " + str(e))
# ---------- end python_3 ----------

# ----
panel_16 = Panel(python_3.out)

# ----
# Animation effect on 3d message, auto detect the type of animation based on text detected in 3d handwritten message.
number_slider_5 = Slider(4, range=0..100)
pt_3 = ConstructPoint(XCoordinate=0, YCoordinate=0, ZCoordinate=0)
Z = UnitZ(Factor=1)
neg = Negative(Value=number_slider_5)
line_2 = LineSDL(Start=python_2.a, Direction=Z, Length=number_slider_5)
dom = ConstructDomain(DomainStart=neg, DomainEnd=number_slider_5)
divide = DivideCurve(Curve=line_2, Count=Slider(5, range=0..10), Kinks=False)  # -> Points, Tangents, Parameters
random = Random(Range=dom, Number="3", Seed=Slider(2996, range=0..10000))
lng_2 = ListLength(List=divide.Points)
random_2 = Random(Range=dom, Number=lng_2, Seed=random)
number_slider_6 = Slider(5, range=0..10)
flip = FlipMatrix(Data=random_2)
item_4 = ListItem(List=flip, Index=0, Wrap=True)  # -> Item, Item1, Item2
division_2 = Division(A=item_4.Item1, B=number_slider_6)
division_3 = Division(A=item_4.Item, B=number_slider_6)
trigger = Trigger(Interval=10, TimerInterval=10, Target=python_4)
number_slider_7 = Slider(0, range=0..1)
message_3dm = Brep(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)
cap = CapHoles(Brep=message_3dm)
python_4 = GhPythonScript()  # -> out, a
# ---------- python_4: Python ----------
import scriptcontext
import ghpythonlib.treehelpers as th

# Initialize or store the value (persistent across iterations)
if not hasattr(scriptcontext, 'value'):
    scriptcontext.value = 0.0  # Initial value
elif scriptcontext.value >= 1.0:
    scriptcontext.value = 0.0

scriptcontext.value += 0.01

# Output the current value
a = scriptcontext.value
print(a)
# ---------- end python_4 ----------
debrep = DeconstructBrep(Brep=cap)  # -> Faces, Edges, Vertices
frame = CurveFrame(Curve=reparameterize(orient.Geometry), Parameter=python_4.out)
avr = Average(Input=debrep.Vertices)
scale = Scale(Geometry=message_3dm, Center=avr, Factor=Slider(0.512, range=0.001..1))  # -> Geometry, Transform
xz = XZPlane(Origin=avr)
orient_2 = Orient(Geometry=scale.Geometry, Source=xz, Target=frame)  # -> Geometry, Transform
material = CreateMaterial(
    Diffuse=ColourSwatch(SwatchColor=RGB(255, 0, 0)),
    Specular=RGB(255, 255, 255),
    Emission=RGB(0, 0, 0),
    Transparency=python_4.out,
    Shine=0)
preview = CustomPreview(Geometry=orient_2.Geometry, Material=material)

pdecon = Deconstruct(Point=divide.Points)  # -> XComponent, YComponent, graft(ZComponent)

pt_4 = ConstructPoint(XCoordinate=division_3, YCoordinate=division_2, ZCoordinate=pdecon.ZComponent)  # -> flatten(Point)
sort = SortList(Keys=flatten(pdecon.ZComponent), ValuesA=pt_4)  # -> Keys, ValuesA
intcrv_2 = Interpolate(Vertices=sort.ValuesA, Degree=3, Periodic=False, KnotStyle=1)  # -> Curve, Length, Domain

# ==== cluster Cluster
L = ClusterInput()
L_2 = ClusterInput()
relay = ClusterInput()
item = ListItem(List=graft(L), Index=relay, Wrap=True)
i = ClusterOutput(item)
item_2 = ListItem(List=L_2, Index=relay, Wrap=True)
i_2 = ClusterOutput(item_2)
